% Simulink data dictionary motorData.sldd

J = Simulink.Parameter(1.66409e-05, DataType="double", Min=1.0e-12, Max=1000)
L = Simulink.Parameter(3.744049e-05, DataType="double", Min=1.0e-12, Max=1000)
R = Simulink.Parameter(3.402602, DataType="double", Min=1.0e-12, Max=1000)
Vbat = Simulink.Parameter(22, DataType="double", Min=1.0e-12, Max=1000)
Fs_max = Simulink.Parameter(0.005451749, DataType="double", Min=0, Max=10)
Km = Simulink.Parameter(0.05026629, DataType="double", Min=1.0e-12, Max=1000)
bp = Simulink.Parameter(2.623617e-05)
bv = Simulink.Parameter(7.41234e-05, DataType="double", Min=1.0e-12, Max=1000)
kp = Simulink.Parameter(1.036952)
omega_bandwidth = Simulink.Parameter(1000000000000, DataType="double")